# Dynamo graph script.dyn "Pin_Закрепить элементы" (Dynamo 2.12.1.8246)

# note: Сбор информации с файла в эксель
# note: Чтение эксель
# note: Имена параметров
# note: Список категорий параметров
# note: Определение тип/экз для параметров
# note: Параметры проекта
# note: Определение каким параметрам и какие катергии не просвоены в проекте.

categories = Categories("OST_RvtLinks")
all_elements_of_category = ElementsOfCategory(Category=categories)
categories_2 = Categories("OST_Grids")
all_elements_of_category_2 = ElementsOfCategory(Category=categories_2)
categories_3 = Categories("OST_Levels")
all_elements_of_category_3 = ElementsOfCategory(Category=categories_3)
join = List.Join(list0=all_elements_of_category, list1=all_elements_of_category_2, list2=all_elements_of_category_3)
code_block = CodeBlock { true; }
# note: Финальные списки
setPinnedStatus = Element.SetPinnedStatus(element=join, pinned=code_block)
