# Dynamo graph script.dyn (Dynamo 2.12.1.8246)

# note: Ритейл
# note: Жилые помещения

# group: Выбор помещений
code_block = CodeBlock { Category.ByName("OST_Rooms"); }
all_elements_of_category = ElementsOfCategory(Category=code_block)
code_block_2 = CodeBlock(a=all_elements_of_category) { [a]; }
code_block_3 = CodeBlock { Category.ByName("OST_RvtLinks"); }
all_elements_of_category_2 = ElementsOfCategory(Category=code_block_3)
code_block_4 = CodeBlock(rooms=all_elements_of_category_2)
# ---------- code_block_4.designscript (4 lines) ----------
DSCore.String.Contains(
rooms.Name,
"Rooms",
true);
# ----------------------------------------
filterByBoolMask = List.FilterByBoolMask(list=all_elements_of_category_2, mask=code_block_4)
python_script = Python(IN[0]=filterByBoolMask.in)  # IronPython2
# ---------- python_script.python (29 lines) ----------
# Загрузить стандартную библиотеку Python и библиотеку DesignScript
import sys
import clr

clr.AddReference('ProtoGeometry')
from Autodesk.DesignScript.Geometry import *
clr.AddReference('RevitAPI')
from Autodesk.Revit.DB import *
clr.AddReference('RevitServices')
from RevitServices.Persistence import DocumentManager
clr.AddReference("RevitAPIUI")
# Введенные в этом узле данные сохраняется в виде списка в переменных IN.
dataEnteringNode = IN
doc = DocumentManager.Instance.CurrentDBDocument

# Разместите код под этой строкой
LinkInstances = IN[0]
LinkDocs=[]

for LinkInstance in LinkInstances:
  LinkDocs.append(UnwrapElement(LinkInstance).GetLinkDocument())

out = []
for LinkDoc in LinkDocs:
	elements = FilteredElementCollector(LinkDoc).OfCategory(BuiltInCategory.OST_Rooms).WhereElementIsNotElementType().ToElements()
	if elements:
		out.append(elements)

OUT = out
# ----------------------------------------
join = List.Join(list0=code_block_2, list1=python_script)
code_block_5 = CodeBlock { false; }
clean = List.Clean(list=join, preserveIndices=code_block_5)

code_block_6 = CodeBlock(els=clean)
# ---------- code_block_6.designscript (6 lines) ----------
lst_els = List.Flatten(
			List.FilterByBoolMask(
				els,
				els.GetParameterValueByName("PS_Назначение_помещения") == "Жилье"
				)["in"]
		);
# ----------------------------------------

# group: Жилые помещения(грпуппировака по прихожей)
code_block_7 = CodeBlock(lst_els=code_block_6)
# ---------- code_block_7.designscript (6 lines) ----------
List.FirstItem(
	DSCore.String.Split(
			lst_els.GetParameterValueByName("ADSK_Номер квартиры в доме"),
			"/"
		)@L2<1>
);
# ----------------------------------------
length = String.Length(string=code_block_7)
code_block_8 = CodeBlock(a=length) { a == 0; }
filterByBoolMask_2 = List.FilterByBoolMask(list=code_block_6, mask=code_block_8)
code_block_9 = CodeBlock(els=filterByBoolMask_2.out) { els.GetParameterValueByName("PS_Секция_Число"); }
sortByKey = List.SortByKey(list=filterByBoolMask_2.out, keys=code_block_9)
groupByKey = List.GroupByKey(list=sortByKey.sortedList, keys=sortByKey.sortedKeys)
code_block_10 = CodeBlock(lst_els=groupByKey.groups)
# ---------- code_block_10.designscript (4 lines) ----------
DSCore.String.Split(
	lst_els.GetParameterValueByName("ADSK_Номер квартиры в доме"),
	"/"
);
# ----------------------------------------
firstItem = List.FirstItem(list=code_block_10@@L2)
toNumber = String.ToNumber(string=firstItem)
sortByKey_2 = List.SortByKey(list=groupByKey.groups@L2, keys=toNumber@L2)
flatten = List.Flatten(list=sortByKey_2.sortedList)
toNumber_2 = String.ToNumber()  # unwired: string

code_block_11 = CodeBlock(a=flatten) { a; }

# group: Жилые помещения(грпуппировака по прихожей)
code_block_12 = CodeBlock(els=code_block_11)
# ---------- code_block_12.designscript (2 lines) ----------
lst_els = List.FilterByBoolMask(els, els.Name == "Прихожая")["in"];
lst_indexes =lst_els.GetParameterValueByName("ADSK_Номер квартиры в доме");
# ----------------------------------------

дастаем_параметры_из_помещений = CodeBlock(els=code_block_12.lst_els)  # "Дастаем параметры из помещений(Собрано по прихожей)"
# ---------- дастаем_параметры_из_помещений.designscript (45 lines) ----------
//(Имя параметра) - (имя в таблице)
els;
//ADSK_Номер квартиры в доме - № квартиры
els.GetParameterValueByName("ADSK_Номер квартиры в доме");
0;

//PS_Секция_число - №Секции
els.GetParameterValueByName("PS_Секция_Число");
4;

//ADSK_Этаж - № Этажа
els.GetParameterValueByName("ADSK_Этаж");
2;

//## AS_Кол-во жилых комнат
els.GetParameterValueByName("ADSK_Количество комнат");
16;

//ADSK_Площадь квартиры жилая - Площадь квартиры жилая
els.GetParameterValueByName("ADSK_Площадь квартиры жилая");
6;

//ADSK_Площадь квартиры - общ.пл. без площади балконов/лоджий...
els.GetParameterValueByName("ADSK_Площадь квартиры");
7;

//ADSK_Площадь с коэффициентом - общ.пл. с площадью балконов/лоджий...(без коэф)
els.GetParameterValueByName("ADSK_Площадь с коэффициентом");
8;

//PS_Площадь квартиры без коэффициента - общ.пл. с площадью балконов/лоджий...(с коэф)
els.GetParameterValueByName("PS_Площадь квартиры без коэффициента ");
9;

// Полная высота - ВЫсота потолков
Math.Round(
(els.GetParameterValueByName("Полная высота"))/1000,2);
17;

// PS_Назначчение_помещения - Назначение помещения
els.GetParameterValueByName("PS_Назначение_помещения");
1;

// PS_Описание помещения
els.GetParameterValueByName("PS_Описание помещения");
# ----------------------------------------
watch = Watch(дастаем_параметры_из_помещений.out7)
путь_к_файлу = Filename("..\..\..\..\..\..\..\01_Рабочие задачи\AR_Квартирография\Сводная таблица ТЭП.xlsx")  # graph input
code_block_13 = CodeBlock()
# ---------- code_block_13.designscript (4 lines) ----------
"общие данные по объекту";
13;
5;
// если поднадобится 5 + section - 1;
# ----------------------------------------
code_block_14 = CodeBlock(ф=clean) { ф; }
code_block_15 = CodeBlock(ф=code_block_14) { ф; }

# group: парковки
categories = Categories("OST_Parking")
all_elements_of_category_3 = ElementsOfCategory(Category=categories)
code_block_16 = CodeBlock(a=all_elements_of_category_3) { a.GetParameterValueByName("ADSK_Позиция"); }

code_block_17 = CodeBlock(lst=code_block_16)
# ---------- code_block_17.designscript (6 lines) ----------
List.Flatten(
	DSCore.String.Split(
		lst,
		"М"
	)
);
# ----------------------------------------
toNumber_3 = String.ToNumber(string=code_block_17)

# group (continued): парковки
sortByKey_3 = List.SortByKey(list=all_elements_of_category_3, keys=toNumber_3)

путь_к_файлу_2 = Filename("..\..\..\..\..\..\..\01_Рабочие задачи\AR_Квартирография\Сводная таблица ТЭП.xlsx")  # graph input
code_block_18 = CodeBlock { "жилые помещения"; 1; 27; }

# group: Считаем колличество квартир по помещениям
code_block_19 = CodeBlock(l=дастаем_параметры_из_помещений.out21) { List.Count(List.FilterByBoolMask(l, l == "Студия")["in"]); }
code_block_20 = CodeBlock(l=дастаем_параметры_из_помещений.out7, студия=code_block_19)
# ---------- code_block_20.designscript (5 lines) ----------
List.Count(List.FilterByBoolMask(l, l == 1)["in"]) - студия;

List.Count(List.FilterByBoolMask(l, l == 2)["in"]);

List.Count(List.FilterByBoolMask(l, l == 3)["in"]);
# ----------------------------------------
list_create = List.Create(item0=code_block_20.out0, item1=code_block_20.out1, item2=code_block_20.out2, item3=code_block_19)

exportToExcel = Data.ExportToExcel(filePath=путь_к_файлу_2, sheetName=code_block_18.out0, startRow=code_block_18.out1, startColumn=code_block_18.out2, data=list_create)
code_block_21 = CodeBlock { "жилые помещения"; 2; 0; }
code_block_22 = CodeBlock { [""]; }

# group: Сбор данных
code_block_23 = CodeBlock(all_rooms=flatten)
# ---------- code_block_23.designscript (3 lines) ----------
//Base data
all_rooms;
numb_at_hose = all_rooms.GetParameterValueByName("ADSK_Номер квартиры в доме");
# ----------------------------------------
code_block_24 = CodeBlock(all_rooms=code_block_23.all_rooms, numb_at_hose=code_block_23.numb_at_hose)
# ---------- code_block_24.designscript (4 lines) ----------
// Лоджия(открытая)
mask = all_rooms.Name == "Лоджия открытая";
fe_rooms = List.FilterByBoolMask(all_rooms,mask)["in"];
fe_indexes = List.FilterByBoolMask(numb_at_hose,mask)["in"];
# ----------------------------------------
code_block_25 = CodeBlock(rooms=code_block_24.fe_rooms, room_keys=code_block_24.fe_indexes)
# ---------- code_block_25.designscript (8 lines) ----------
// Лоджия(открытая)
fe_group = List.GroupByKey(rooms, room_keys);
DSCore.Math.Sum(
		fe_group["groups"].GetParameterValueByName(
		"PS_Площадь помещения (замороженная)"
	)
);
out_keys = fe_group["unique keys"];
# ----------------------------------------
code_block_26 = CodeBlock(all_rooms=code_block_23.all_rooms, numb_at_hose=code_block_23.numb_at_hose)
# ---------- code_block_26.designscript (4 lines) ----------
// Ладжия(Закрытая)
mask = all_rooms.Name == "Лоджия (холодная)" || (all_rooms.Name == "Лоджия");
fe_rooms = List.FilterByBoolMask(all_rooms,mask)["in"];
fe_indexes = List.FilterByBoolMask(numb_at_hose,mask)["in"];
# ----------------------------------------
code_block_27 = CodeBlock(rooms=code_block_26.fe_rooms, room_keys=code_block_26.fe_indexes)
# ---------- code_block_27.designscript (8 lines) ----------
// Ладжия(Закрытая)
fe_group = List.GroupByKey(rooms, room_keys);
DSCore.Math.Sum(
		fe_group["groups"].GetParameterValueByName(
		"PS_Площадь помещения (замороженная)"
	)
);
out_keys = fe_group["unique keys"];
# ----------------------------------------
code_block_28 = CodeBlock(all_rooms=code_block_23.all_rooms, numb_at_hose=code_block_23.numb_at_hose)
# ---------- code_block_28.designscript (4 lines) ----------
// Балкон
mask = all_rooms.Name == "Балкон";
fe_rooms = List.FilterByBoolMask(all_rooms,mask)["in"];
fe_indexes = List.FilterByBoolMask(numb_at_hose,mask)["in"];
# ----------------------------------------
code_block_29 = CodeBlock(rooms=code_block_28.fe_rooms, room_keys=code_block_28.fe_indexes)
# ---------- code_block_29.designscript (8 lines) ----------
// Балкон
fe_group = List.GroupByKey(rooms, room_keys);
DSCore.Math.Sum(
		fe_group["groups"].GetParameterValueByName(
		"PS_Площадь помещения (замороженная)"
	)
);
out_keys = fe_group["unique keys"];
# ----------------------------------------
code_block_30 = CodeBlock(all_rooms=code_block_23.all_rooms, numb_at_hose=code_block_23.numb_at_hose)
# ---------- code_block_30.designscript (4 lines) ----------
// Терраса
mask = all_rooms.Name == "Терраса";
fe_rooms = List.FilterByBoolMask(all_rooms,mask)["in"];
fe_indexes = List.FilterByBoolMask(numb_at_hose,mask)["in"];
# ----------------------------------------
code_block_31 = CodeBlock(rooms=code_block_30.fe_rooms, room_keys=code_block_30.fe_indexes)
# ---------- code_block_31.designscript (8 lines) ----------
// Терраса
fe_group = List.GroupByKey(rooms, room_keys);
DSCore.Math.Sum(
		fe_group["groups"].GetParameterValueByName(
		"PS_Площадь помещения (замороженная)"
	)
);
out_keys = fe_group["unique keys"];
# ----------------------------------------
code_block_32 = CodeBlock(all_rooms=code_block_23.all_rooms, numb_at_hose=code_block_23.numb_at_hose)
# ---------- code_block_32.designscript (4 lines) ----------
// С/У
mask = all_rooms.Name == "С/У";
fe_rooms = List.FilterByBoolMask(all_rooms,mask)["in"];
fe_indexes = List.FilterByBoolMask(numb_at_hose,mask)["in"];
# ----------------------------------------
code_block_33 = CodeBlock(rooms=code_block_32.fe_rooms, room_keys=code_block_32.fe_indexes)
# ---------- code_block_33.designscript (4 lines) ----------
// с/у
fe_group = List.GroupByKey(rooms, room_keys);
List.Count(fe_group["groups"]@L2<2>);
room_keys;
# ----------------------------------------
code_block_34 = CodeBlock(all_rooms=code_block_23.all_rooms, numb_at_hose=code_block_23.numb_at_hose)
# ---------- code_block_34.designscript (4 lines) ----------
// Кухня
mask = all_rooms.Name == "Кухня";
fe_rooms = List.FilterByBoolMask(all_rooms,mask)["in"];
fe_indexes = List.FilterByBoolMask(numb_at_hose,mask)["in"];
# ----------------------------------------
code_block_35 = CodeBlock(rooms=code_block_34.fe_rooms, room_keys=code_block_34.fe_indexes)
# ---------- code_block_35.designscript (8 lines) ----------
// Кухня
fe_group = List.GroupByKey(rooms, room_keys);
DSCore.Math.Sum(
		fe_group["groups"].GetParameterValueByName(
		"PS_Площадь помещения (замороженная)"
	)
);
out_keys = fe_group["unique keys"];
# ----------------------------------------
code_block_36 = CodeBlock(all_rooms=code_block_23.all_rooms, numb_at_hose=code_block_23.numb_at_hose)
# ---------- code_block_36.designscript (4 lines) ----------
// Кухня-ниша
mask = all_rooms.Name =="Кухня-ниша";
fe_rooms = List.FilterByBoolMask(all_rooms,mask)["in"];
fe_indexes = List.FilterByBoolMask(numb_at_hose,mask)["in"];
# ----------------------------------------
code_block_37 = CodeBlock(rooms=code_block_36.fe_rooms, room_keys=code_block_36.fe_indexes)
# ---------- code_block_37.designscript (8 lines) ----------
// Кухня-ниша
fe_group = List.GroupByKey(rooms, room_keys);
DSCore.Math.Sum(
		fe_group["groups"].GetParameterValueByName(
		"PS_Площадь помещения (замороженная)"
	)
);
out_keys = fe_group["unique keys"];
# ----------------------------------------
code_block_38 = CodeBlock(all_rooms=code_block_23.all_rooms, numb_at_hose=code_block_23.numb_at_hose)
# ---------- code_block_38.designscript (4 lines) ----------
// Кухня-столовая
mask = all_rooms.Name == "Кухня-столовая";
fe_rooms = List.FilterByBoolMask(all_rooms,mask)["in"];
fe_indexes = List.FilterByBoolMask(numb_at_hose,mask)["in"];
# ----------------------------------------
code_block_39 = CodeBlock(rooms=code_block_38.fe_rooms, room_keys=code_block_38.fe_indexes)
# ---------- code_block_39.designscript (8 lines) ----------
// Кухня-столовая
fe_group = List.GroupByKey(rooms, room_keys);
DSCore.Math.Sum(
		fe_group["groups"].GetParameterValueByName(
		"PS_Площадь помещения (замороженная)"
	)
);
out_keys = fe_group["unique keys"];
# ----------------------------------------

# group: Создание предварительных списков для обьединения(int)
py_генерация_первичного_списка_с = Python(IN[0]=code_block_12.lst_indexes, IN[1]=code_block_25.out1, IN[2]=code_block_25.out_keys)  # "py_Генерация первичного списка с прапусками(Л)"; IronPython2
# ---------- py_генерация_первичного_списка_с.python (15 lines) ----------
base_indexes = IN[0]
area_values = IN[1]
room_indexes = IN[2]

out_to_ex = []
out_to_sum = []
for base_index in base_indexes:
    if base_index in room_indexes:
        out_to_ex.append(area_values[room_indexes.index(base_index)])
        out_to_sum.append(area_values[room_indexes.index(base_index)])
    else:
        out_to_ex.append('')
        out_to_sum.append(0)

OUT = out_to_ex, out_to_sum
# ----------------------------------------
py_генерация_первичного_списка_с_2 = Python(IN[0]=code_block_12.lst_indexes, IN[1]=code_block_27.out1, IN[2]=code_block_27.out_keys)  # "py_Генерация первичного списка с прапусками(ЛЗак)"; IronPython2; same code as py_генерация_первичного_списка_с
py_генерация_первичного_списка_с_3 = Python(IN[0]=code_block_12.lst_indexes, IN[1]=code_block_29.out1, IN[2]=code_block_29.out_keys)  # "py_Генерация первичного списка с прапусками(Б)"; IronPython2; same code as py_генерация_первичного_списка_с
py_генерация_первичного_списка_с_4 = Python(IN[0]=code_block_12.lst_indexes, IN[1]=code_block_31.out1, IN[2]=code_block_31.out_keys)  # "py_Генерация первичного списка с прапусками(Т)"; IronPython2; same code as py_генерация_первичного_списка_с
py_генерация_первичного_списка_с_5 = Python(IN[0]=code_block_12.lst_indexes, IN[1]=code_block_35.out1, IN[2]=code_block_35.out_keys)  # "py_Генерация первичного списка с прапусками(Кухня)"; IronPython2
# ---------- py_генерация_первичного_списка_с_5.python (12 lines) ----------
base_indexes = IN[0]
area_values = IN[1]
room_indexes = IN[2]

out = []
for base_index in base_indexes:
    if base_index in room_indexes:
        out.append(area_values[room_indexes.index(base_index)])
    else:
        out.append('')

OUT = out
# ----------------------------------------
py_генерация_первичного_списка_с_6 = Python(IN[0]=code_block_12.lst_indexes, IN[1]=code_block_37.out1, IN[2]=code_block_37.out_keys)  # "py_Генерация первичного списка с прапусками(Кухня-ниша)"; IronPython2; same code as py_генерация_первичного_списка_с_5
py_генерация_первичного_списка_с_7 = Python(IN[0]=code_block_12.lst_indexes, IN[1]=code_block_39.out1, IN[2]=code_block_39.out_keys)  # "py_Генерация первичного списка с прапусками(Кухня-столовая)"; IronPython2; same code as py_генерация_первичного_списка_с_5

# group: Создание предварительных списков для обьединения(str)
code_block_40 = CodeBlock(a=py_генерация_первичного_списка_с) { a[0]; }
python_script_2 = Python(IN[0]=code_block_40)  # IronPython2
# ---------- python_script_2.python (8 lines) ----------
lst = []
for i in IN[0]:
	if i == '':
		lst.append('')
	else:
		lst.append('Лоджия открытая')
				
OUT = lst
# ----------------------------------------
code_block_41 = CodeBlock(a=py_генерация_первичного_списка_с_2) { a[0]; }
python_script_3 = Python(IN[0]=code_block_41)  # IronPython2
# ---------- python_script_3.python (8 lines) ----------
lst = []
for i in IN[0]:
	if i == '':
		lst.append('')
	else:
		lst.append('Лоджия закрытая')
				
OUT = lst
# ----------------------------------------
code_block_42 = CodeBlock(a=py_генерация_первичного_списка_с_3) { a[0]; }
python_script_4 = Python(IN[0]=code_block_42)  # IronPython2
# ---------- python_script_4.python (8 lines) ----------
lst = []
for i in IN[0]:
	if i == '':
		lst.append('')
	else:
		lst.append('Балкон')
				
OUT = lst
# ----------------------------------------
code_block_43 = CodeBlock(a=py_генерация_первичного_списка_с_4) { a[0]; }
python_script_5 = Python(IN[0]=code_block_43)  # IronPython2
# ---------- python_script_5.python (8 lines) ----------
lst = []
for i in IN[0]:
	if i == '':
		lst.append('')
	else:
		lst.append('Терраса')
				
OUT = lst
# ----------------------------------------

code_block_44 = CodeBlock(ЛЗак=py_генерация_первичного_списка_с_2, Л=py_генерация_первичного_списка_с, Б=py_генерация_первичного_списка_с_3, Т=py_генерация_первичного_списка_с_4) { ЛЗак[1]+Л[1]+Б[1]+Т[1]; }
code_block_45 = CodeBlock(a=code_block_33.out1) { a; }
list_create_2 = List.Create(item0=дастаем_параметры_из_помещений.out1, item1=дастаем_параметры_из_помещений.out19, item2=дастаем_параметры_из_помещений.out5, item3=code_block_22, item4=дастаем_параметры_из_помещений.out3, item5=code_block_22, item6=дастаем_параметры_из_помещений.out9, item7=дастаем_параметры_из_помещений.out11, item8=дастаем_параметры_из_помещений.out13, item9=дастаем_параметры_из_помещений.out15, item10=python_script_2, item11=code_block_40, item12=python_script_3, item13=code_block_41, item14=python_script_4, item15=code_block_42, item16=python_script_5, item17=code_block_43, item18=code_block_44, item19=дастаем_параметры_из_помещений.out7, item20=дастаем_параметры_из_помещений.out17, item21=code_block_45, item22=code_block_22, item23=code_block_22, item24=py_генерация_первичного_списка_с_5, item25=py_генерация_первичного_списка_с_6, item26=py_генерация_первичного_списка_с_7)
transpose = List.Transpose(lists=list_create_2)
exportToExcel_2 = Data.ExportToExcel(filePath=путь_к_файлу_2, sheetName=code_block_21.out0, startRow=code_block_21.out1, startColumn=code_block_21.out2, data=transpose)
code_block_46 = CodeBlock(drop=clean) { drop; }
code_block_47 = CodeBlock(drop=code_block_46) { drop; }
стопер_транзакции = CodeBlock(st1=exportToExcel, st2=exportToExcel_2, drop=code_block_47, pathc=путь_к_файлу_2) { st1[0]; st2[0]; drop; pathc; }
code_block_48 = CodeBlock(path=стопер_транзакции.pathc) { path; }

# group: МОП
code_block_49 = CodeBlock { "МОП,Тех"; 1; 0; }
code_block_50 = CodeBlock(lst_els=стопер_транзакции.drop)
# ---------- code_block_50.designscript (4 lines) ----------
List.Flatten(lst_els);
List.Flatten(
lst_els.GetParameterValueByName("ADSK_Номер помещения квартиры")
);
# ----------------------------------------
code_block_51 = CodeBlock { "М"; "Т"; }
startsWith = String.StartsWith(string=code_block_50.out1, searchFor=code_block_51.out0)
filterByBoolMask_3 = List.FilterByBoolMask(list=code_block_50.out0, mask=startsWith)
startsWith_2 = String.StartsWith(string=code_block_50.out1, searchFor=code_block_51.out1)
filterByBoolMask_4 = List.FilterByBoolMask(list=code_block_50.out0, mask=startsWith_2)

join_2 = List.Join(list0=filterByBoolMask_3.in, list1=filterByBoolMask_4.in)

# group: Новая сортировка
code_block_52 = CodeBlock(els=join_2) { els.GetParameterValueByName("PS_Секция_Число"); }
sortByKey_4 = List.SortByKey(list=join_2, keys=code_block_52)
groupByKey_2 = List.GroupByKey(list=sortByKey_4.sortedList, keys=sortByKey_4.sortedKeys)
code_block_53 = CodeBlock(lst_els=groupByKey_2.groups) { lst_els.GetParameterValueByName("ADSK_Номер квартиры в доме"); }
sortByKey_5 = List.SortByKey(list=groupByKey_2.groups@L2, keys=code_block_53@L2)
flatten_2 = List.Flatten(list=sortByKey_5.sortedList)
code_block_54 = CodeBlock(els=flatten_2) { els.GetParameterValueByName("PS_Секция_Число"); }

# group (continued): МОП
string_from_object = FromObject(object=code_block_54)

code_block_55 = CodeBlock(lst_strs=string_from_object)
# ---------- code_block_55.designscript (6 lines) ----------
List.FirstItem(
	DSCore.String.Split(
			lst_strs,
			","
		)@L2<1>
);
# ----------------------------------------

# group (continued): МОП
дастаем_параметры_из_помещений_2 = CodeBlock(els=flatten_2, section=code_block_55)  # "Дастаем параметры из помещений(Собрано по прихожей)"
# ---------- дастаем_параметры_из_помещений_2.designscript (29 lines) ----------
//(Имя параметра) - (имя в таблице)
els;

// №п/п
1..List.Count(els)..1;
0;

//Имя - вид помещения
els.Name;
1;

//Местоположение
"Подьезд - " + section + ": Этаж " + els.GetParameterValueByName("ADSK_Этаж");

// PS_Назначчение_помещения - Назначение помещения
els.GetParameterValueByName("PS_Назначение_помещения")=="МОП"?
"Общественное":"Техническое";
3;

//ADSK_Площадь квартиры жилая - Площадь квартиры жилая
els.GetParameterValueByName("PS_Площадь помещения (замороженная)");



Math.Round(
(els.GetParameterValueByName("Полная высота"))/1000,2);
4;

els.GetParameterValueByName("PS_Секция_Число");
# ----------------------------------------
list_create_3 = List.Create(item0=дастаем_параметры_из_помещений_2.out1, item1=дастаем_параметры_из_помещений_2.out3, item2=дастаем_параметры_из_помещений_2.out5, item3=дастаем_параметры_из_помещений_2.out6, item4=дастаем_параметры_из_помещений_2.out8)
transpose_2 = List.Transpose(lists=list_create_3)
exportToExcel_3 = Data.ExportToExcel(filePath=code_block_48, sheetName=code_block_49.out0, startRow=code_block_49.out1, startColumn=code_block_49.out2, data=transpose_2)

code_block_56 = CodeBlock(drop=стопер_транзакции.drop) { drop; }
стопер_транзакции_2 = CodeBlock(st1=exportToExcel_3, drop=code_block_56, pathc=code_block_48) { st1[0]; drop; pathc; }
code_block_57 = CodeBlock { "нежилые помещения коммерческие"; 1; 0; }

# group: Ритейл(грпуппировака по имени)
code_block_58 = CodeBlock(els=стопер_транзакции_2.drop)
# ---------- code_block_58.designscript (9 lines) ----------
lst_els = List.Flatten(
List.FilterByBoolMask(
	els,
	els.GetParameterValueByName("PS_Назначение_помещения") == "Ритейл"
	)["in"]
);
List.Flatten(
lst_els.GetParameterValueByName("ADSK_Номер помещения квартиры")
);
# ----------------------------------------
length_2 = String.Length(string=code_block_58.out1)
code_block_59 = CodeBlock(a=length_2) { a == 0; }
filterByBoolMask_5 = List.FilterByBoolMask(list=code_block_58.lst_els, mask=code_block_59)

# group: Новая сортировка
code_block_60 = CodeBlock(els=filterByBoolMask_5.out) { els.GetParameterValueByName("PS_Секция_Число"); }
sortByKey_6 = List.SortByKey(list=filterByBoolMask_5.out, keys=code_block_60)
groupByKey_3 = List.GroupByKey(list=sortByKey_6.sortedList, keys=sortByKey_6.sortedKeys)
code_block_61 = CodeBlock(lst_els=groupByKey_3.groups) { lst_els.GetParameterValueByName("ADSK_Номер квартиры в доме"); }
sortByKey_7 = List.SortByKey(list=groupByKey_3.groups@L2, keys=code_block_61@L2)
flatten_3 = List.Flatten(list=sortByKey_7.sortedList)

# note: Ритейл
дастаем_параметры_из_помещений_3 = CodeBlock(els=flatten_3)  # "Дастаем параметры из помещений(Собрано по прихожей)"
# ---------- дастаем_параметры_из_помещений_3.designscript (28 lines) ----------
//(Имя параметра) - (имя в таблице)
els;
//ADSK_Номер квартиры в доме - № квартиры
els.GetParameterValueByName("ADSK_Номер помещения квартиры");
0;

//Имя - Начзачение
els.GetParameterValueByName("Имя");
1;

//PS_Секция_число - №Секции
els.GetParameterValueByName("PS_Секция_Число");
3;

//ADSK_Этаж - № Этажа
els.GetParameterValueByName("ADSK_Этаж");
5;

//Общая площадь
els.GetParameterValueByName("ADSK_Площадь квартиры");

//ADSK_Площадь квартиры жилая - Площадь квартиры жилая
els.GetParameterValueByName("PS_Площадь помещения (замороженная)");
8;

// Полная высота - ВЫсота потолков
(els.GetParameterValueByName("Полная высота"))/1000;
9;
# ----------------------------------------
code_block_62 = CodeBlock { ""; }
list_create_4 = List.Create(item0=code_block_62)
list_create_5 = List.Create(item0=дастаем_параметры_из_помещений_3.out1, item1=дастаем_параметры_из_помещений_3.out3, item2=list_create_4, item3=дастаем_параметры_из_помещений_3.out5, item4=list_create_4, item5=дастаем_параметры_из_помещений_3.out7, item6=дастаем_параметры_из_помещений_3.out9, item7=list_create_4, item8=дастаем_параметры_из_помещений_3.out10, item9=дастаем_параметры_из_помещений_3.out12)
transpose_3 = List.Transpose(lists=list_create_5)
exportToExcel_4 = Data.ExportToExcel(filePath=стопер_транзакции_2.pathc, sheetName=code_block_57.out0, startRow=code_block_57.out1, startColumn=code_block_57.out2, data=transpose_3)
стопер_транзакции_3 = CodeBlock(st1=exportToExcel_4, drop=стопер_транзакции_2.drop, pathc=стопер_транзакции_2.pathc) { st1[0]; drop; pathc; }
code_block_63 = CodeBlock { "нежилые помещения - кладовые"; 1; 0; }

# group: Кладовые
code_block_64 = CodeBlock(els=стопер_транзакции_3.drop)
# ---------- code_block_64.designscript (9 lines) ----------
lst_els = List.Flatten(
List.FilterByBoolMask(
	els,
	els.GetParameterValueByName("PS_Назначение_помещения") == "Кладовая"
	)["in"]
);
List.Flatten(
lst_els.GetParameterValueByName("ADSK_Номер помещения квартиры")
);
# ----------------------------------------
length_3 = String.Length(string=code_block_64.out1)
code_block_65 = CodeBlock(a=length_3) { a == 0; }
filterByBoolMask_6 = List.FilterByBoolMask(list=code_block_64.lst_els, mask=code_block_65)

# group: Новая сортировка
code_block_66 = CodeBlock(els=filterByBoolMask_6.out) { els.GetParameterValueByName("PS_Секция_Число"); }
sortByKey_8 = List.SortByKey(list=filterByBoolMask_6.out, keys=code_block_66)
groupByKey_4 = List.GroupByKey(list=sortByKey_8.sortedList, keys=sortByKey_8.sortedKeys)
code_block_67 = CodeBlock(lst_els=groupByKey_4.groups) { lst_els.GetParameterValueByName("ADSK_Номер квартиры в доме"); }
sortByKey_9 = List.SortByKey(list=groupByKey_4.groups@L2, keys=code_block_67@L2)
flatten_4 = List.Flatten(list=sortByKey_9.sortedList)

дастаем_параметры_из_помещений_4 = CodeBlock(els=flatten_4)  # "Дастаем параметры из помещений(Собрано по прихожей)"; same code as дастаем_параметры_из_помещений_3
code_block_68 = CodeBlock { ""; }
list_create_6 = List.Create(item0=code_block_68)
list_create_7 = List.Create(item0=дастаем_параметры_из_помещений_4.out1, item1=дастаем_параметры_из_помещений_4.out3, item2=list_create_6, item3=дастаем_параметры_из_помещений_4.out5, item4=list_create_6, item5=дастаем_параметры_из_помещений_4.out7, item6=дастаем_параметры_из_помещений_4.out9, item7=list_create_6, item8=дастаем_параметры_из_помещений_4.out10, item9=дастаем_параметры_из_помещений_4.out12)
transpose_4 = List.Transpose(lists=list_create_7)
exportToExcel_5 = Data.ExportToExcel(filePath=стопер_транзакции_3.pathc, sheetName=code_block_63.out0, startRow=code_block_63.out1, startColumn=code_block_63.out2, data=transpose_4)
code_block_69 = CodeBlock(a=sortByKey_3.sortedList, start=exportToExcel_5, path=стопер_транзакции_3.pathc) { a; start; path; }
code_block_70 = CodeBlock { "нежилые помещения - машино-мест"; 1; 0; }
code_block_71 = CodeBlock(a=code_block_69.a) { a.GetParameterValueByName("ADSK_Позиция"); a.Name; a.GetParameterValueByName("ADSK_Размер_Площадь"); }
list_create_8 = List.Create(item0=code_block_71.out0, item1=code_block_71.out1, item2=code_block_71.out2)
transpose_5 = List.Transpose(lists=list_create_8)
exportToExcel_6 = Data.ExportToExcel(filePath=code_block_69.path, sheetName=code_block_70.out0, startRow=code_block_70.out1, startColumn=code_block_70.out2, data=transpose_5)
code_block_72 = CodeBlock(rooms=code_block_15, start=exportToExcel_6) { rooms; start; }

# group: Выбираем паркинг
code_block_73 = CodeBlock(lst_el=code_block_72.rooms) { lst_els = List.Flatten(lst_el); lst_els.GetParameterValueByName("PS_Назначение_помещения") == "Паркинг"; }
filterByBoolMask_7 = List.FilterByBoolMask(list=code_block_73.lst_els, mask=code_block_73.out1)
code_block_74 = CodeBlock(lst_els=filterByBoolMask_7.in) { lst_els.GetParameterValueByName("PS_Секция_Число"); }

sortByKey_10 = List.SortByKey(list=filterByBoolMask_7.in, keys=code_block_74)

# group (continued): Выбираем паркинг
groupByKey_5 = List.GroupByKey(list=sortByKey_10.sortedList, keys=sortByKey_10.sortedKeys)

# group: Жилые помещения(грпуппировака по прихожей)
code_block_75 = CodeBlock(els=code_block_72.rooms)
# ---------- code_block_75.designscript (6 lines) ----------
lst_els = List.Flatten(
List.FilterByBoolMask(els, els.Name == "Прихожая")["in"]
);
List.Flatten(
lst_els.GetParameterValueByName("ADSK_Номер помещения квартиры")
);
# ----------------------------------------
length_4 = String.Length(string=code_block_75.out1)
code_block_76 = CodeBlock(a=length_4) { a == 0; }
filterByBoolMask_8 = List.FilterByBoolMask(list=code_block_75.lst_els, mask=code_block_76)
code_block_77 = CodeBlock(lst_els=filterByBoolMask_8.out) { lst_els.GetParameterValueByName("PS_Секция_Число"); }

sortByKey_11 = List.SortByKey(list=filterByBoolMask_8.out, keys=code_block_77)

# group (continued): Жилые помещения(грпуппировака по прихожей)
groupByKey_6 = List.GroupByKey(list=sortByKey_11.sortedList, keys=sortByKey_11.sortedKeys)

count = List.Count(list=groupByKey_6.uniqueKeys)
code_block_78 = CodeBlock(rooms=groupByKey_6.groups)
# ---------- code_block_78.designscript (11 lines) ----------
// Жилая площадь
Math.Sum(rooms.GetParameterValueByName("ADSK_Площадь квартиры жилая"));

// Суммарная площадь квартир
Math.Sum(rooms.GetParameterValueByName("ADSK_Площадь квартиры"));

// Суммарная общая площадь квартир (без понижающего коэфф.)
Math.Sum(rooms.GetParameterValueByName("PS_Площадь квартиры без коэффициента "));

// Суммарная общая площадь квартир (с понижающим коэфф.)
Math.Sum(rooms.GetParameterValueByName("ADSK_Площадь с коэффициентом"));
# ----------------------------------------

# group: Сдвиг на 1
code_block_79 = CodeBlock(test=groupByKey_5.uniqueKeys) { test; }
code_block_80 = CodeBlock { [""]; }
join_3 = List.Join(list0=code_block_80, list1=code_block_78.out0)
расширение_списка = CodeBlock(test=code_block_79, count_LRooms=count, next=code_block_78.out0, next_plus=join_3) { List.Count(test) == count_LRooms; next; next_plus; }
if_ = RefactoredIf(test=расширение_списка.out0, true=расширение_списка.next, false=расширение_списка.next_plus)
join_4 = List.Join(list0=code_block_80, list1=code_block_78.out1)
расширение_списка_2 = CodeBlock(test=code_block_79, count_LRooms=count, next=code_block_78.out1, next_plus=join_4) { List.Count(test) == count_LRooms; next; next_plus; }
if_2 = RefactoredIf(test=расширение_списка_2.out0, true=расширение_списка_2.next, false=расширение_списка_2.next_plus)
join_5 = List.Join(list0=code_block_80, list1=code_block_78.out2)
расширение_списка_3 = CodeBlock(test=code_block_79, count_LRooms=count, next=code_block_78.out2, next_plus=join_5) { List.Count(test) == count_LRooms; next; next_plus; }
if_3 = RefactoredIf(test=расширение_списка_3.out0, true=расширение_списка_3.next, false=расширение_списка_3.next_plus)
join_6 = List.Join(list0=code_block_80, list1=code_block_78.out3)
расширение_списка_4 = CodeBlock(test=code_block_79, count_LRooms=count, next=code_block_78.out3, next_plus=join_6) { List.Count(test) == count_LRooms; next; next_plus; }
if_4 = RefactoredIf(test=расширение_списка_4.out0, true=расширение_списка_4.next, false=расширение_списка_4.next_plus)

# group: МОП
code_block_81 = CodeBlock(lst_els=code_block_72.rooms)  # same code as code_block_50
code_block_82 = CodeBlock { "М"; }
startsWith_3 = String.StartsWith(string=code_block_81.out1, searchFor=code_block_82)
filterByBoolMask_9 = List.FilterByBoolMask(list=code_block_81.out0, mask=startsWith_3)
code_block_83 = CodeBlock(lst_els=filterByBoolMask_9.in) { lst_els.GetParameterValueByName("PS_Секция_Число"); }

sortByKey_12 = List.SortByKey(list=filterByBoolMask_9.in, keys=code_block_83)

# group (continued): МОП
groupByKey_7 = List.GroupByKey(list=sortByKey_12.sortedList, keys=sortByKey_12.sortedKeys)

code_block_84 = CodeBlock(rooms=groupByKey_7.groups)
# ---------- code_block_84.designscript (2 lines) ----------
// Площадь
Math.Sum(rooms.GetParameterValueByName("PS_Площадь помещения (замороженная)"));
# ----------------------------------------

# group: Сдвиг на 1
code_block_85 = CodeBlock { [""]; }
join_7 = List.Join(list0=code_block_85, list1=code_block_84)
расширение_списка_5 = CodeBlock(test=code_block_84, count_LRooms=count, next_plus=join_7, next=code_block_84) { List.Count(test) == count_LRooms; next_plus; next; }
if_5 = RefactoredIf(test=расширение_списка_5.out0, true=расширение_списка_5.next_plus, false=расширение_списка_5.next)

# group: Выбираем технические помещения
code_block_86 = CodeBlock(lst_el=code_block_72.rooms) { lst_els = List.Flatten(lst_el); lst_els.GetParameterValueByName("PS_Назначение_помещения") == "Техническое"; }
filterByBoolMask_10 = List.FilterByBoolMask(list=code_block_86.lst_els, mask=code_block_86.out1)

# group: Разделяем Тех.подполье
code_block_87 = CodeBlock(a=filterByBoolMask_10.in) { a.Name == "Тех.подполье"; }
filterByBoolMask_11 = List.FilterByBoolMask(list=filterByBoolMask_10.in, mask=code_block_87)

# group: Тех.подполье
code_block_88 = CodeBlock(lst_els=filterByBoolMask_11.in) { lst_els.GetParameterValueByName("PS_Секция_Число"); }
sortByKey_13 = List.SortByKey(list=filterByBoolMask_11.in, keys=code_block_88)
groupByKey_8 = List.GroupByKey(list=sortByKey_13.sortedList, keys=sortByKey_13.sortedKeys)
code_block_89 = CodeBlock(rooms=groupByKey_8.groups)
# ---------- code_block_89.designscript (2 lines) ----------
// Площадь технических
Math.Sum(rooms.GetParameterValueByName("PS_Площадь помещения (замороженная)"));
# ----------------------------------------

code_block_90 = CodeBlock(test=groupByKey_8.uniqueKeys) { DSCore.Object.IsNull(test)[0]; }

# group: Технические
code_block_91 = CodeBlock(lst_els=filterByBoolMask_11.out) { lst_els.GetParameterValueByName("PS_Секция_Число"); }
sortByKey_14 = List.SortByKey(list=filterByBoolMask_11.out, keys=code_block_91)
groupByKey_9 = List.GroupByKey(list=sortByKey_14.sortedList, keys=sortByKey_14.sortedKeys)
code_block_92 = CodeBlock(rooms=groupByKey_9.groups)  # same code as code_block_84

py_генерация_первичного_списка_с_8 = Python(IN[0]=groupByKey_8.uniqueKeys, IN[1]=code_block_92, IN[2]=groupByKey_9.uniqueKeys)  # "py_Генерация первичного списка с прапусками(Технические)"; IronPython2
# ---------- py_генерация_первичного_списка_с_8.python (22 lines) ----------
List_Count = IN[0]
List_Zero = []

for i in List_Count:
    List_Zero.append(0)

Values = IN[1]
Positions = IN[2]

for pos in Positions:
	List_Zero.insert(pos, Values[Positions.index(pos)])
	
out1 = List_Zero[1:len(List_Count)+1]

out2 = []
for j in out1:
    if str(j) == "0":
        out2.append("")
    else:
        out2.append(j)
        
OUT = out2
# ----------------------------------------
if_6 = RefactoredIf(test=code_block_90, true=code_block_92, false=py_генерация_первичного_списка_с_8)

# group: Сдвиг на 1
code_block_93 = CodeBlock { [""]; }
join_8 = List.Join(list0=code_block_93, list1=if_6)
расширение_списка_6 = CodeBlock(test=if_6, count_LRooms=count, next_plus=join_8, next=if_6) { List.Count(test) == count_LRooms; next_plus; next; }
if_7 = RefactoredIf(test=расширение_списка_6.out0, true=расширение_списка_6.next_plus, false=расширение_списка_6.next)

flatten_5 = List.Flatten(list=groupByKey_8.groups)
code_block_94 = CodeBlock(test=flatten_5) { DSCore.Object.IsNull(test)[0]; }
code_block_95 = CodeBlock { [""]; }
if_8 = RefactoredIf(test=code_block_94, true=code_block_95, false=code_block_89)

# group: Сдвиг на 1
code_block_96 = CodeBlock { [""]; }
join_9 = List.Join(list0=code_block_96, list1=if_8)
расширение_списка_7 = CodeBlock(test=if_8, count_LRooms=count, next_plus=join_9, next=if_8) { List.Count(test) == count_LRooms; next_plus; next; }
if_9 = RefactoredIf(test=расширение_списка_7.out0, true=расширение_списка_7.next_plus, false=расширение_списка_7.next)

code_block_97 = CodeBlock { [""]; }

# group: Кладовки
code_block_98 = CodeBlock(els=code_block_72.rooms)
# ---------- code_block_98.designscript (6 lines) ----------
lst_els = List.Flatten(
List.FilterByBoolMask(els, els.Name == "Кладовая")["in"]
);
List.Flatten(
lst_els.GetParameterValueByName("ADSK_Номер помещения квартиры")
);
# ----------------------------------------
length_5 = String.Length(string=code_block_98.out1)
code_block_99 = CodeBlock(a=length_5) { a == 0; }
filterByBoolMask_12 = List.FilterByBoolMask(list=code_block_98.lst_els, mask=code_block_99)
code_block_100 = CodeBlock(lst_els=filterByBoolMask_12.out) { lst_els.GetParameterValueByName("PS_Секция_Число"); }

sortByKey_15 = List.SortByKey(list=filterByBoolMask_12.out, keys=code_block_100)

# group (continued): Кладовки
groupByKey_10 = List.GroupByKey(list=sortByKey_15.sortedList, keys=sortByKey_15.sortedKeys)

code_block_101 = CodeBlock(a=groupByKey_10.uniqueKeys) { a-1; }
code_block_102 = CodeBlock(rooms=groupByKey_10.groups)  # same code as code_block_84
python_script_6 = Python(IN[0]=count, IN[1]=code_block_101, IN[2]=code_block_102)  # IronPython2
# ---------- python_script_6.python (1 lines) ----------
OUT = [IN[2][IN[1].index(i)] if i in IN[1] else "" for i in range(IN[0])]
# ----------------------------------------

# group: Сдвиг на 1
code_block_103 = CodeBlock { [""]; }
join_10 = List.Join(list0=code_block_103, list1=python_script_6)
расширение_списка_8 = CodeBlock(test=groupByKey_10.uniqueKeys, count_LRooms=count, next_plus=join_10, next=python_script_6) { List.Count(test) != count_LRooms; next_plus; next; }
if_10 = RefactoredIf(test=расширение_списка_8.out0, true=расширение_списка_8.next_plus, false=расширение_списка_8.next)

list_create_9 = List.Create(item0=if_, item1=if_2, item2=if_3, item3=if_4, item4=if_5, item5=if_7, item6=if_9, item7=code_block_97, item8=if_10)
exportToExcel_7 = Data.ExportToExcel(filePath=путь_к_файлу, sheetName=code_block_13.out0, startRow=code_block_13.out1, startColumn=code_block_13.out2, data=list_create_9)

# group: парковки
categories_2 = Categories("OST_Parking")
all_elements_of_category_4 = ElementsOfCategory(Category=categories_2)
code_block_104 = CodeBlock(a=all_elements_of_category_4) { a.GetParameterValueByName("ADSK_Позиция"); }
toNumber_4 = String.ToNumber(string=code_block_104)
sortByKey_16 = List.SortByKey(list=all_elements_of_category_4, keys=toNumber_4)

code_block_105 = CodeBlock(a=sortByKey_16.sortedList) { Math.Sum(a.GetParameterValueByName("ADSK_Размер_Площадь")); }
code_block_106 = CodeBlock(rooms=groupByKey_5.groups)  # same code as code_block_84
list_create_10 = List.Create(item0=code_block_105, item1=code_block_106)
code_block_107 = CodeBlock(ф=exportToExcel_7, path=путь_к_файлу, data=list_create_10) { ф; path; data; }
code_block_108 = CodeBlock()
# ---------- code_block_108.designscript (4 lines) ----------
"общие данные по объекту";
22;
4;
// если поднадобится 5 + section - 1;
# ----------------------------------------
exportToExcel_8 = Data.ExportToExcel(filePath=code_block_107.path, sheetName=code_block_108.out0, startRow=code_block_108.out1, startColumn=code_block_108.out2, data=code_block_107.data)
python_script_7 = Python()  # IronPython2; frozen; unwired: IN[0]
# ---------- python_script_7.python (29 lines) ----------
# Загрузить стандартную библиотеку Python и библиотеку DesignScript
import sys
import clr

clr.AddReference('ProtoGeometry')
from Autodesk.DesignScript.Geometry import *
clr.AddReference('RevitAPI')
from Autodesk.Revit.DB import *
clr.AddReference('RevitServices')
from RevitServices.Persistence import DocumentManager
clr.AddReference("RevitAPIUI")
# Введенные в этом узле данные сохраняется в виде списка в переменных IN.
dataEnteringNode = IN
doc = DocumentManager.Instance.CurrentDBDocument

# Разместите код под этой строкой
LinkInstances = FilteredElementCollector(doc, doc.ActiveView.Id).OfCategory(BuiltInCategory.OST_RvtLinks).WhereElementIsNotElementType().ToElements()
LinkDocs=[]

for LinkInstance in LinkInstances:
  LinkDocs.append(LinkInstance.GetLinkDocument())

out = []
for LinkDoc in LinkDocs:
	elements = FilteredElementCollector(LinkDoc).OfCategory(BuiltInCategory.OST_Rooms).WhereElementIsNotElementType().ToElements()
	if elements:
		out.append(elements)

OUT = out
# ----------------------------------------
winforms_example = Python()  # IronPython2; frozen; unwired: IN[0]
# ---------- winforms_example.python (149 lines) ----------
#! /usr/bin/env python
# -*- coding: utf-8 -*-
import sys
import clr
clr.AddReference("System.Drawing")
clr.AddReference("System.Windows.Forms")

from System.Windows.Forms import Application, Form, FormWindowState, Screen, Label, PictureBox, PictureBoxSizeMode, \
    AnchorStyles, BorderStyle, ComboBox, ComboBoxStyle, FormBorderStyle, CheckBox, TextBox, TextBoxBase
from System.Windows.Forms import Button, LinkLabel, Panel, Button
from System.Drawing import Icon, Color, Font, Point, Size
import System.IO

#------ Глобальные настройки формы ------#
bitmapImage = System.Drawing.Bitmap(
    r"Z:\01_Библиотека\02_Семейства\ALL_Основные надписи\Логотип\\" + "Логотип Партнер.png")  # Логотип
titleIcon = Icon.FromHandle(bitmapImage.GetHicon())
titleText = "Собираем ТЭП"  # текст, который появляется в строке заголовка GUI
txtWith = 160 # ширина текстовой зоны
st_height = 30 # высота с кототорой начинается ввод
btnHeight = 40  # Высота кнопки
btnWidth = 100  # Ширина кнопки
btnSpacing = 20  # оступ элементов от края окна
htSpacing = 50  # Интервал между вводам данных
fontMessage = Font("Times New Roman ", 15)
fontCK = Font("Times New Roman ", 12)  # настройка шрифта у Checkbox
winSize = Size(400, 250)  # размеры winform (ширина(min = 300), высота).


def button(txt, loc, clc):
    btn = Button()
    # btnCancel.Parent = self
    btn.Text = txt
    btn.Anchor = (AnchorStyles.Bottom | AnchorStyles.Right)
    btn.Location = loc
    btn.Click += clc
    btn.Height = btnHeight
    btn.Width = btnWidth
    btn.BackColor = Color.FromArgb(220, 220, 220)
    return btn


def logo(uiH):
    logo = PictureBox()
    bitmapImage = System.Drawing.Bitmap(
        r"Z:\01_Библиотека\02_Семейства\ALL_Основные надписи\Логотип\\" + "Лого Партнер горизонтальный полный прозрачный фон.png")
    logo.Image = bitmapImage
    ratio = float(logo.Height) / float(logo.Width)  # должно быть значение с плавающей точкой, так как int округляется до ближайшего целого числа
    logo.Size = Size(200, 80 * ratio)  # размер логотипа
    logo.Location = Point(btnSpacing, (uiH - logo.Height) - btnSpacing)
    logo.SizeMode = PictureBoxSizeMode.Zoom  # масштабирование изображения
    logo.Anchor = (
                AnchorStyles.Bottom | AnchorStyles.Left)  # Привязка для охранения положения при масштабировании окна
    return logo


out = []
class WinForm(Form):
    def add_Logotxt(self, uiW, value):
        label_class = Label()
        font = fontMessage
        label_class.Text = value
        label_class.Font = font
        label_class.Location = Point(btnSpacing, btnSpacing)
        label_class.Height = htSpacing
        label_class.Width = uiW
        return label_class

    def add_CHECKBOX(self, uiW, count=1,name="Пример ввода", value="Пример ввода!!"):
        ch_box = CheckBox()
        ch_box.Name = name
        ch_box.Text = value
        ch_box.Location = Point(btnSpacing, st_height + (count * htSpacing))
        ch_box.Width = uiW - (btnSpacing * 2)
        ch_box.Font = fontCK
        ch_box.Height = 40
        return ch_box

    def add_txtbox(self,uiW, count=1):#(self,uiW, count=1, value="Пример ввода") - если нужно в рамку добавить тест описания
        # окно ввода данных
        text_box = TextBox()
        text_box.Width = uiW / 2 - 2*btnSpacing
        #text_box.Text = value
        text_box.Font = fontCK
        text_box.Location = Point(htSpacing + txtWith, (st_height + htSpacing * count))
        return text_box

    def add_txtbox_label(self, count=1, name = "Пример ввода"):
        # текст возле ввода данных
        text_box_label = Label()
        text_box_label.Text = name
        text_box_label.Width = txtWith
        text_box_label.Font = fontCK
        text_box_label.Location = Point(btnSpacing, (st_height + htSpacing * count))
        text_box_label.Height = 50
        return text_box_label

    def okButton_pressed(self, sender, args):
        chBox_checks = []
        numErrorProvider = System.Windows.Forms.ErrorProvider()
        try:
            for lst_txtBox in self.lst_txtBoxses:
                out.append(lst_txtBox.Text)
            self.Close()  # Тригер для закрытия окна
        except ValueError:
            numErrorProvider.SetError(sender, 'Ошибка')

    def __init__(self):
        #------ Настройка окна ------#
        self.CenterToScreen()  # открывать по центру экрана
        self.BringToFront()  # Выводить на предний план
        self.Icon = titleIcon
        self.Size = winSize
        uiWidth = self.DisplayRectangle.Width  # ширина формы для использования в классе
        uiHeight = self.DisplayRectangle.Height # высота формы для использования в классе
        self.Topmost = True # Отобрадение окна поверх других окон
        self.BackColor = Color.FromArgb(242, 242, 242)

        self.Controls.Add(logo(uiHeight))

        self.Text = titleText # Текст заголовка

        # Настройка текста в форме(можно добавить к кажой кнопке, но это гемор)

        self.Controls.Add(self.add_Logotxt(uiWidth,
                                      "Введите значение")
                          )
        #----- добавить ввод данных с клавиатуры -----#

        #Добавляем текст поля ввода
        self.Controls.Add(self.add_txtbox_label(1, "Начальный номер секции в файле"))

        #Добавляем поле ввода
        self.sect_numb = self.add_txtbox(uiWidth, 1)
        self.lst_txtBoxses = [self.sect_numb] # формируем список из полей вставки (нужно для вывода)
        self.Controls.Add(self.sect_numb)

        # ----- добавить кнопку -----#
        btnOkClick = self.okButton_pressed  # Регистрация нажатия
        # Ниже одна кнопка. Для расчета нужно btnWidth * кол-во кнопок
        btnOkLoc = Point(uiWidth - ((btnWidth) + btnSpacing), uiHeight - (btnHeight + btnSpacing)) #Расчет положения.
        btnOk = button('OK', btnOkLoc, btnOkClick)
        self.Controls.Add(btnOk)


form = WinForm()
Application.Run(form)

OUT = int(out[0])# print заменить на out
# ----------------------------------------
code_block_109 = CodeBlock { DSCore.Object.IsNull(test)?[""]:l2; }  # unwired: test, l2
